vi "Lab5RxTemplate.gvi"   [LabVIEW Communications System Design Software 2.0.1]
panel controls:
  "IQ rate": f64 = 200000
  "carrier frequency": f64 = 915000000
  "gain (dB)": f64
  "active antenna": string = "RX2"
  "number of samples": i64 = 200000
  "stop": bool
  "niUSRP Device": "niUSRPClass"
panel indicators:
  "actual IQ rate": f64
  "actual carrier frequency": f64
  "actual gain (dB)": f64
  "error out": error
  "Phase Error": f64[]
  "Demodulated Output": waveform<f64>[]
uses:
  NI::Analysis::Filtering::Median Filter.gvi
  NI::Analysis::Conditioning::Unwrap Phase.gvi
diagram:
  w1 = $"number of samples"
  call "niUSRP Open Rx Session.gvi"(niUSRP Device=$"niUSRP Device") -> (error out=w2, session handle out=w3)
  call "niUSRP Configure Signal.gvi"(session handle=w3, IQ rate=$"IQ rate", carrier frequency=$"carrier frequency", gain=$"gain (dB)", error in (no error)=w2, active antenna=$"active antenna") -> (session handle out=w4, coerced IQ rate=w5, coerced carrier frequency=w6, coerced gain=w7, Error Out=w8)
  call "niUSRP Initiate.gvi"(session handle=w4, error in (no error)=w8) -> (session handle out=w9, Error Out=w10)
  while {
    call "niUSRP Fetch Rx Data (CDB WDT).gvi"(session handle=w9, number of samples=w1, error in (no error)=w10) -> (session handle out=w11, data=w12, Error Out=w13)
    Logical Or(w13, $stop) -> w14
    Property Node(instance in=w12) -> ("Y"=w15, "dt"=w16, "Y"=w17)
    Complex To Polar(r * e^(i*theta)=w17) -> (r=w18)
    Build Waveform Node(Y=w18, dt=w16) -> (output waveform=w19)
    Square(x=w17) -> w20
    Complex To Polar(r * e^(i*theta)=w20) -> (theta=w21)
    call "Median Filter.gvi"(signal=w21) -> (filtered signal=w22)
    call "Unwrap Phase.gvi"(input phase=w22) -> (unwrapped phase=w23, error out=w24)
    Divide(x=w23, y=2) -> w25
    Polar To Complex(r=1, theta=w25) -> (r * e^(i*theta)=w26)
    Complex Conjugate(x + iy=w26) -> w27
    Multiply(w15, w27) -> w28
    Complex To Polar(r * e^(i*theta)=w28) -> (r=w29)
    Build Waveform Node(Y=w29, dt=w16) -> (output waveform=w30)
    Build Array(w30, w19) -> w31
    $"Demodulated Output" <- w31
    Property Node(instance in=w24)
    $"Phase Error" <- w25
    stop if w14
  }
  call "niUSRP Abort.gvi"(Handle in=w11, error in (no error)=w13) -> (Handle out=w32, Error Out=w33)
  call "niUSRP Close Session.gvi"(handle in=w32, error in=w33) -> (error out=w34)
  call "Simple Error Handler.gvi"(error in=w34) -> (error out=w35)
  $"error out" <- w35
  $"actual IQ rate" <- w5
  $"actual carrier frequency" <- w6
  $"actual gain (dB)" <- w7
