vi "Lab5TxTemplate.gvi"   [LabVIEW Communications System Design Software 2.0.1]
panel controls:
  "IQ rate": f64 = 200000
  "carrier frequency": f64 = 915000000
  "gain (dB)": f64
  "active antenna": string = "TX1"
  "message length (samples)": f64 = 200000
  "start frequency": f64 = 1000
  "delta frequency": f64 = 1000
  "#tones": i32 = 3
  "stop": bool
  "Device names": "niUSRPClass"
panel indicators:
  "actual IQ rate": f64
  "actual carrier frequency": f64
  "actual gain (dB)": f64
  "error out": error
  "Message": waveform<f64>
diagram:
  call "niUSRP Open Tx Session.gvi"(Device names=$"Device names") -> (session handle out=w1, Error Out=w2)
  call "niUSRP Configure Signal.gvi"(session handle=w1, IQ rate=$"IQ rate", carrier frequency=$"carrier frequency", gain=$"gain (dB)", error in (no error)=w2, active antenna=$"active antenna") -> (session handle out=w3, coerced IQ rate=w4, coerced carrier frequency=w5, coerced gain=w6, Error Out=w7)
  Property Node(instance in=cluster{"Fs": f64, "#s": f64} {"Fs"=1000, "#s"=1000}, "#s"=$"message length (samples)", "Fs"=w4) -> (instance out=w8)
  w9 = TRUE  # coerce frequencies
  call "Basic Multitone.gvi"(start frequency=$"start frequency", seed=1, delta frequency=$"delta frequency", #tones=$"#tones", amplitude=1, sampling info=w8, coerce frequencies?=w9) -> (signal out=w10)
  $Message <- w10
  Property Node(instance in=w10) -> ("Y"=w11)
  call "Quick Scale 1D.gvi"(X=w11) -> (Y[i]=X[i]/Max|X|=w12)
  Array Size(array=w11) -> (size(s)=w13)
  Initialize Array(element=0, size=w13) -> w14
  Real And Imaginary To Complex(x=w12, y=w14) -> w15
  while {
    call "niUSRP Write Tx Data (CDB).gvi"(session handle=w3, data=w15, end of data?=$stop, error in (no error)=w7) -> (session handle out=w16, Error Out=w17)
    Logical Or(w17, $stop) -> w18
    stop if w18
  }
  call "niUSRP Close Session.gvi"(handle in=w16, error in=w17) -> (error out=w19)
  call "Simple Error Handler.gvi"(error in=w19) -> (error out=w20)
  $"error out" <- w20
  $"actual IQ rate" <- w4
  $"actual carrier frequency" <- w5
  $"actual gain (dB)" <- w6
